# Grasshopper definition Tetra_Growth_Reader_0.gh (Grasshopper 1.0.5)
# plug-ins: SpatialSlur.SlurGH, Weaverbird

timer = Timer(TimerInterval=5000, Target=c_script)  # disabled
c_script = CSharpScript(
    path="C:\Users\David\Desktop\IO\Tetra_0",
    read=Toggle(True),
    Reference="C:\Users\David\AppData\Roaming\Grasshopper\Libraries\SpatialSlur\SpatialSlur.dll")  # -> out, result; inputs path: String, read: Boolean
# ---------- c_script: C# ----------
    if(read)
    {
      var coords = CoreIO.DeserializeBinary<List<double>>(path);
      result = ToPoint3d(coords);
    }
# ---------- c_script: C# additional code ----------
  IEnumerable<Point3d> ToPoint3d(List<double> coords)
  {
    for(int i = 0; i < coords.Count; i += 3)
      yield return new Point3d(coords[i], coords[i + 1], coords[i + 2]);
  }
# ---------- end c_script ----------
partition = PartitionList(List=c_script.result, Size=4)
face = MeshFace([{A=1, B=2, C=3, D=3}, {A=0, B=1, C=3, D=3}, {A=0, B=2, C=1, D=1}, {A=0, B=3, C=2, D=2}])
conmesh = ConstructMesh(Vertices=partition, Faces=face)
wbtriangles = WeaverbirdsSplitTrianglesSubdivision(MeshCurves=conmesh, Level=2)
merge = Merge(Data1=ColourSwatch(SwatchColor=RGB(255, 255, 255)), Data2=ColourSwatch(SwatchColor=RGB(153, 153, 153)))
wbloop = WeaverbirdsLoopSubdivision(MeshCurves=wbtriangles, Level=1, SmoothNakedEdges=1)
normshade = NormalShader(Mesh=wbloop, Colors=merge, Direction=Vector(0, 0, 1))
